# Grasshopper definition latent-points.gh (Grasshopper 1.0.8)
# plug-ins: RhinoCodePluginGH

mesh = Mesh(<mesh referenced from the Rhino model>)
python_3_script = Python3Script(mesh=mesh)  # -> out, a, b, c; inputs mesh: Mesh
# ---------- python_3_script: Python ----------
import copy
import Rhino.Geometry as rg

min_bound = -1
max_bound = 1

box = [
    rg.Point3d(-1, -1, -1),
    rg.Point3d(1, 1, 1)
]

bbox = mesh.GetBoundingBox(True)
# bbox = rg.BoundingBox(box)
bbox_mesh = rg.Mesh.CreateFromBox(bbox, 2, 2, 2)

# b = rg.Mesh.CreateFromBox(bbox, 5, 5, 5)

for vi, vertex in enumerate(bbox_mesh.Vertices):
    new_vertex = mesh.ClosestMeshPoint(vertex, 0)

    bbox_mesh.Vertices[vi] = new_vertex.Point

a = bbox_mesh
# ---------- end python_3_script ----------
deconstruct_mesh = DeconstructMesh(Mesh=python_3_script.a)  # -> Vertices, Faces, Colours, Normals
