# Grasshopper definition latent-points-viz.gh (Grasshopper 1.0.8)

mesh = Mesh([<mesh referenced from the Rhino model> x2])
mesh_2 = Mesh([<mesh referenced from the Rhino model> x2])
mesh_3 = Mesh([<mesh referenced from the Rhino model> x2])
mesh_4 = Mesh([<mesh referenced from the Rhino model> x2])
colour_picker = ColourPicker(PickedColour=RGBA(0, 0, 0, 24))
deconstruct_mesh = DeconstructMesh(Mesh=mesh)  # -> Vertices, Faces, Colours, Normals
mesh_edges = MeshEdges(Mesh=mesh_2)  # -> NakedEdges, InteriorEdges, NonManifoldEdges
deconstruct_mesh_2 = DeconstructMesh(Mesh=mesh_2)  # -> Vertices, Faces, Colours, Normals
mesh_edges_2 = MeshEdges(Mesh=mesh_3)  # -> NakedEdges, InteriorEdges, NonManifoldEdges
deconstruct_mesh_3 = DeconstructMesh(Mesh=mesh_3)  # -> Vertices, Faces, Colours, Normals
custom_preview = CustomPreview(Geometry=mesh_4, Material=colour_picker)
point = Point(Point(-1, 0, 0))
point_2 = Point(Point(-1, 0, 0))
move = Move(Geometry=deconstruct_mesh.Vertices, Motion=point)  # -> Geometry, Transform
move_2 = Move(Geometry=[mesh_edges_2.NakedEdges, mesh_edges_2.InteriorEdges, mesh_edges_2.NonManifoldEdges], Motion=point_2)  # -> Geometry, Transform
geometry = Geometry([move.Geometry, deconstruct_mesh_2.Vertices, deconstruct_mesh.Vertices])
colour_picker_2 = ColourPicker(PickedColour=RGB(0, 0, 255))
sphere = Sphere(Base=geometry, Radius=0.02)
custom_preview_2 = CustomPreview(Geometry=sphere, Material=colour_picker_2)
