# Grasshopper definition shrink-wrap.gh (Grasshopper 1.0.8)
# plug-ins: RhinoCodePluginGH

mesh = Mesh(<mesh referenced from the Rhino model>)
python_3_script = Python3Script(x=mesh)  # -> out, a, b; inputs x: list of Mesh
# ---------- python_3_script: Python ----------
# requirements: numpy

import numpy as np
import Rhino.Geometry as rg

def get_direction(vertex, bbox, tol=1e-6):
    """
    vertex : rg.Point3d  (정육면체 표면 위에 있는 점)
    bbox   : rg.BoundingBox  (정육면체의 바운딩박스)
    tol    : float        (부동소수점 비교용 오차 허용 범위)

    returns: rg.Vector3d  (투사 방향 벡터 d = (dx, dy, dz))
    """
    # x축 방향 결정
    if abs(vertex.X - bbox.Max.X) < tol:
        dx =  1
    elif abs(vertex.X - bbox.Min.X) < tol:
        dx = -1
    else:
        dx =  0

    # y축 방향 결정
    if abs(vertex.Y - bbox.Max.Y) < tol:
        dy =  1
    elif abs(vertex.Y - bbox.Min.Y) < tol:
        dy = -1
    else:
        dy =  0

    # z축 방향 결정
    if abs(vertex.Z - bbox.Max.Z) < tol:
        dz =  1
    elif abs(vertex.Z - bbox.Min.Z) < tol:
        dz = -1
    else:
        dz =  0

    # 최종 방향 벡터
    direction = rg.Vector3d(dx, dy, dz)

    return direction


joined_mesh = rg.Mesh()
for x_ in x:
    joined_mesh.Append(x_)

# 입력 메쉬 x의 바운딩박스 가져오기
bbox = joined_mesh.GetBoundingBox(True) # True for world coordinates

bbox.Transform(rg.Transform.Scale((bbox.Min + bbox.Max) * 0.5, 1.2))

# 메쉬 생성
c = 60
mesh_box = rg.Mesh.CreateFromBox(bbox, c, c, c)

# ShrinkWrap 파라미터 설정
# shrink_wrap_params = rg.ShrinkWrapParameters()
# shrink_wrap_params.Offset = 0
# shrink_wrap_params.PolygonOptimization = 0
# shrink_wrap_params.TargetEdgeLength = 0.01
# shrink_wrapped = x.ShrinkWrap(shrink_wrap_params)
shrink_wrapped = joined_mesh

b = []

# 각 버텍스를 입력 메쉬로 투사
for vi, (vertex, normal) in enumerate(zip(mesh_box.Vertices, mesh_box.Normals)):
    ray = rg.Ray3d(vertex, -get_direction(vertex, bbox))
    t = rg.Intersect.Intersection.MeshRay(shrink_wrapped, ray)
    
    if t == float('-inf'):
        # 가장 가까운 점 찾기
        closest_point = shrink_wrapped.ClosestMeshPoint(vertex, 0)
        new_vertex = closest_point.Point
    else:
        new_vertex = ray.PointAt(t)
    
    mesh_box.Vertices[vi] = new_vertex

    mesh_point = shrink_wrapped.ClosestMeshPoint(new_vertex, 0)
    normal = shrink_wrapped.NormalAt(mesh_point)
    b.append(normal)

a = mesh_box
# b = [bbox.Min, bbox.Max]
# ---------- end python_3_script ----------
deconstruct_mesh = DeconstructMesh(Mesh=python_3_script.a)  # -> Vertices, Faces, Colours, Normals
point = Point(deconstruct_mesh.Vertices)
